vi "Create EChart.gvi"   [LabVIEW NXG 5.0.0]
inputs:
  "placeholder reference": "HtmlContainer reference"
  "error in": error
outputs:
  "error out": error
  "echart out": "NI.JavaScriptReference"
uses:
  ECharts::Shared Options::Set Animation Options.gvi
  ECharts::Shared Options::Set Color Options.gvi
  ECharts::Shared Options::Set Text Style Options.gvi
  ECharts::Support::ECharts.jsli::CreateEChart
  ECharts::Core::Update EChart Options.gvi
diagram:
  Obtain JavaScript Reference(reference in=$"placeholder reference") -> (javascript reference out=w1)
  w2 = [4286191129, 4278882018, 4292982147, 4290161445, 4289584110, 4288645807, 4286479998, 4282058533]
  call "Set Animation Options.gvi"(animation?=FALSE) -> (echart options out=w3)
  call "Set Color Options.gvi"(echart options in=w3, color=w2) -> (echart options out=w4)
  # Create the echart and set defaults. This will disable animations by default, use an NXG color palette, and NXG default fonts.
  call "Set Text Style Options.gvi"(echart options in=w4, color=4281020467, font family="Segoe UI", font size=9) -> (echart options out=w5)
  call "CreateEChart"(parent=w1, error in=$"error in") -> (echart=w6, error out=w7)
  call "Update EChart Options.gvi"(echart=w6, error in=w7, echart options=w5) -> (echart out=w8, error out=w9)
  Close Reference(error in=w9, reference=w1) -> (error out=w10)
  $"error out" <- w10
  $"echart out" <- w8
