vi "Destroy EChart.gvi"   [LabVIEW NXG 5.0.0]
inputs:
  "echart": "NI.JavaScriptReference"
  "error in": error
outputs:
  "error out": error
uses:
  ECharts::Support::ECharts.jsli::DestroyEChart
diagram:
  call "DestroyEChart"(echart=$echart) -> (error out=w1)
  Merge Errors($"error in", w1) -> (error out=w2)
  $"error out" <- w2
