vi "Update EChart Options.gvi"   [LabVIEW NXG 5.0.0]
inputs:
  "echart": "NI.JavaScriptReference", required
  "echart options": "echart options.gtype", required
  "error in": error
outputs:
  "error out": error
  "echart out": "NI.JavaScriptReference"
types:
  "option.gtype" = cluster{"path": string[], "propertiesJSON": string}
  "echart options.gtype" = "option.gtype"[]
uses:
  ECharts::Support::ECharts.jsli::UpdateEChart
diagram:
  $"echart out" <- $echart
  Flatten To Json(anything=$"echart options") -> (JSON string=w1)
  call "UpdateEChart"(echart=$echart, options array json=w1, error in=$"error in") -> (error out=w2)
  $"error out" <- w2
